# Dynamo graph move_room_tags_to_center_v1_script.dyn (Dynamo 2.12.1.8246)

python_script = Python()  # CPython3; unwired: IN[0]
# ---------- python_script.python (53 lines) ----------
import clr

clr.AddReference('RevitAPI')
clr.AddReference('RevitAPIUI')
import Autodesk
from Autodesk.Revit.DB import *
from Autodesk.Revit.DB import Transaction
from Autodesk.Revit.DB import FilteredElementCollector, BuiltInCategory
from Autodesk.Revit.DB.Architecture import Room

clr.AddReference('RevitServices')
import RevitServices
from RevitServices.Persistence import DocumentManager

doc = DocumentManager.Instance.CurrentDBDocument
uidoc = DocumentManager.Instance.CurrentUIApplication.ActiveUIDocument

# this is the completly wrong approach for what I need.
# This gets all tags from the current fiew and then finds the room from the tag. 
# There's a race condition here, the tags don't have the udpated room location points

# instead could I do it in reverse? Get the rooms and then find the tag

room_list = []
def tags_to_room_center():
    # TESTED REVIT API:
    # 2022.1
    # __author__ = Matt Vogel & @gtalarico
    # __version__ = '0.0.2'

    ###########################################################################
    # TAG COLLECTOR [IN VIEW BY: doc.ActiveView.Id]
    room_tags = FilteredElementCollector(doc, doc.ActiveView.Id).OfCategory(
                BuiltInCategory.OST_RoomTags).WhereElementIsNotElementType().\
                ToElements()
    ###########################################################################

    transaction = Transaction(doc, 'Move Room Tags on Room Points')
    transaction.Start()
    for room_tag in room_tags:
        room_tag_pt = room_tag.Location.Point
        room = room_tag.Room
        room_pt = room.Location.Point
        new_x = room_pt.X - room_tag_pt.X
        new_y = room_pt.Y - room_tag_pt.Y
        new_z = room_pt.Z - room_tag_pt.Z

        translation = XYZ(new_x, new_y, new_z)
        room_tag.Location.Move(translation)

    transaction.Commit()

tags_to_room_center()
# ----------------------------------------
